test file "Conceptual design phase"

suite "Model linearization"

  case "Linearization test 1" [baseline]
    model plant_VV_l, harness plant_VV_l_Harness
    signal scenario: Doublet_T (plant_VV_l_Harness/Signal Editor)
    baseline "linarization_baseline_1.mat": rel tol 0.001
      Xe:1
      Ve:1
      Att:1
      Omega:1

  case "Linearization test 2" [baseline]
    model plant_VV_l, harness plant_VV_l_Harness, stop time 5
    signal scenario: Doublet_Mx (plant_VV_l_Harness/Signal Editor)
    baseline "linarization_baseline_2.mat": rel tol 0.001
      Xe:1: rel tol 0.005
      Ve:1: rel tol 0.005
      Att:1
      Omega:1

  case "Linearization test 3" [baseline]
    model plant_VV_l, harness plant_VV_l_Harness, stop time 5
    signal scenario: Doublet_My (plant_VV_l_Harness/Signal Editor)
    baseline "linarization_baseline_3.mat": rel tol 0.001
      Xe:1: rel tol 0.005
      Ve:1: rel tol 0.005
      Att:1
      Omega:1

  case "Linearization test 4" [baseline]
    model plant_VV_l, harness plant_VV_l_Harness
    signal scenario: Doublet_Mz (plant_VV_l_Harness/Signal Editor)
    baseline "linarization_baseline_4.mat": rel tol 0.001
      Xe:1
      Ve:1
      Att:1
      Omega:1

suite "Requirements verification"

  case "AD-Sys-CL-08-14-CS-19" [simulation]
    model plant_control, harness plant_control_Harness_roll, mode Normal
    custom criteria:
      Data = getElement(test.sltest_simout.yout, '').Values.Data;
      maxRoll = max(Data);
      test.verifyLessThan(maxRoll,60,'The roll angle must be less than 60 deg');