% Requirement links of control_law_design.m (R2023a)

% line 63 relates to GNC_preliminary_requirements.slreqx#21
% line 63 relates to GNC_preliminary_requirements.slreqx#26
% line 63 relates to GNC_preliminary_requirements.slreqx#37
% line 63 relates to GNC_preliminary_requirements.slreqx#30
Kp_p = 11.275;

% line 65 relates to GNC_preliminary_requirements.slreqx#21
% line 65 relates to GNC_preliminary_requirements.slreqx#26
% line 65 relates to GNC_preliminary_requirements.slreqx#37
% line 65 relates to GNC_preliminary_requirements.slreqx#30
Kp_r = 15.136;

% lines 92-94 relates to GNC_preliminary_requirements.slreqx#22
% lines 92-94 relates to GNC_preliminary_requirements.slreqx#27
% lines 92-94 relates to GNC_preliminary_requirements.slreqx#38
% lines 92-94 relates to GNC_preliminary_requirements.slreqx#33
Kp_roll = 2.5734;
Kp_pitch = 2.5734;
Kp_yaw = 2.5734;

% lines 167-171 relates to GNC_preliminary_requirements.slreqx#24
% lines 167-171 relates to GNC_preliminary_requirements.slreqx#28
% lines 167-171 relates to GNC_preliminary_requirements.slreqx#39
% lines 167-171 relates to GNC_preliminary_requirements.slreqx#34
Kp_vx = -0.05623;
Kp_vy = 0.05623;
Kp_vz = 6.0256;
Td = 2/1;
Ti = 10/1;

% lines 201-203 relates to GNC_preliminary_requirements.slreqx#25
% lines 201-203 relates to GNC_preliminary_requirements.slreqx#36
% lines 201-203 relates to GNC_preliminary_requirements.slreqx#40
% lines 201-203 relates to GNC_preliminary_requirements.slreqx#35
Kp_x = 0.83272;
Kp_y = 0.83272;
Kp_z = 0.5290;